# Grasshopper definition Steel Frames.gh (Grasshopper 1.0.7)
# plug-ins: Karamba3D, Kangaroo2 Components, Pancake

# ----
# Adjust pathing in output groups
# Press 'play' to start generation
timer = Timer(Interval=10, TimerInterval=10, Target=simple_counter)  # disabled
simple_counter = CSharpScript()  # -> out, A, B
# ---------- simple_counter: C# usings ----------
using System.IO;
using System.Linq;
using System.Data;
using System.Drawing;
using System.Reflection;
using System.Windows.Forms;
using System.Xml;
using System.Xml.Linq;
using System.Runtime.InteropServices;

using Rhino.DocObjects;
using Rhino.Collections;
using GH_IO;
using GH_IO.Serialization;
# ---------- simple_counter: C# ----------
    _counter = _counter + 1;


    A = _counter;
# ---------- simple_counter: C# additional code ----------
  double _counter = 0;
# ---------- end simple_counter ----------
num = Number(simple_counter.A)
python = GhPythonScript(x=num)  # -> out, a, b
# ---------- python: Python ----------
__author__ = "Tom"
__version__ = "2024.04.14"

import rhinoscriptsyntax as rs

a = x - x//30 * 30


b =  x//30 - x//900 *30
# ---------- end python ----------
addition = Addition(A=python.a, B=Slider(10, range=0..100))
addition_2 = Addition(A=python.b, B=Slider(10, range=0..100))
panel = Panel(addition)
panel_2 = Panel(addition_2)

number_slider = Slider(6, range=0..10)
number_slider_2 = Slider(0.3, range=0.3..1)
neg = Negative(Value=number_slider_2)
neg_2 = Negative(Value=number_slider_2)
division = Division(A=addition, B=Slider(2, range=0..10))
pt = ConstructPoint(XCoordinate=addition, YCoordinate=0, ZCoordinate=0)
pt_2 = ConstructPoint(XCoordinate=0, YCoordinate=0, ZCoordinate=number_slider)
pt_3 = ConstructPoint(XCoordinate=0, YCoordinate=0, ZCoordinate=0)
pt_4 = ConstructPoint(XCoordinate=addition, YCoordinate=0, ZCoordinate=Slider(6, range=0..10))
pt_5 = ConstructPoint(XCoordinate=number_slider_2, YCoordinate=number_slider_2, ZCoordinate=0)
pt_6 = ConstructPoint(XCoordinate=neg, YCoordinate=number_slider_2, ZCoordinate=0)
pt_7 = ConstructPoint(XCoordinate=number_slider_2, YCoordinate=neg_2, ZCoordinate=0)
pt_8 = ConstructPoint(XCoordinate=neg, YCoordinate=neg, ZCoordinate=0)
division_2 = Division(A=addition_2, B=Slider(7.2, range=7.2..10))
number_slider_3 = Slider(1, range=0..1)
Z = UnitZ(Factor=number_slider_3)
move = Move(Geometry=pt_3, Motion=Z)  # -> Geometry, Transform
pt_9 = ConstructPoint(XCoordinate=division, YCoordinate=0, ZCoordinate=Slider(8.06, range=8.06..10))
int = Integer(division_2)
neg_3 = Negative(Value=number_slider_3)
srf4pt = _4PointSurface(CornerA=pt_5, CornerB=pt_7, CornerC=pt_8, CornerD=pt_6)
Z_2 = UnitZ(Factor=neg_3)
move_2 = Move(Geometry=pt_2, Motion=Z_2)  # -> Geometry, Transform
number_slider_4 = Slider(-1, range=-1..0)
division_3 = Division(A=addition_2, B=int)
ln = Line(StartPoint=move.Geometry, EndPoint=move_2.Geometry)
Z_3 = UnitZ(Factor=Slider(-2.5, range=-10..-2.5))
addition_3 = Addition(A=int, B=Slider(1, range=0..1))
series = Series(Start=0, Step=division_3, Count=addition_3)
divide = DivideCurve(Curve=ln, Count=Slider(2, range=0..10), Kinks=False)  # -> Points, Tangents, Parameters
X = UnitX(Factor=addition)
Y = UnitY(Factor=series)
ln_2 = Line(StartPoint=pt, EndPoint=pt_4)
ln_3 = Line(StartPoint=pt_2, EndPoint=pt_9)
series_2 = Series(Start=0, Step=1, Count=Slider(4, range=0..10))
ln_4 = Line(StartPoint=pt_9, EndPoint=pt_4)
ln_5 = Line(StartPoint=pt_3, EndPoint=pt_2)
extr = Extrude(Base=srf4pt, Direction=Z_3)
move_3 = Move(Geometry=extr, Motion=X)  # -> Geometry, Transform
Y_2 = UnitY(Factor=addition_2)
item = ListItem(List=divide.Points, Index=series_2, Wrap=True)
division_4 = Division(A=addition, B=Slider(2, range=0..10))
num_2 = Number(division_4)
Y_3 = UnitY(Factor=addition_2)
move_4 = Move(Geometry=pt_2, Motion=Y_2)  # -> Geometry, Transform
division_5 = Division(A=num_2, B=Slider(2.5, range=0..10))
move_5 = Move(Geometry=item, Motion=Y_3)  # -> Geometry, Transform
int_2 = Integer(division_5)
pt_10 = ConstructPoint(XCoordinate=0, YCoordinate=division_3, ZCoordinate=0)
pt_11 = Point(pt_3)
pt_12 = ConstructPoint(XCoordinate=0, YCoordinate=division_3, ZCoordinate=number_slider)
pt_13 = Point(pt_2)
move_6 = Move(Geometry=extr, Motion=Y)  # -> Geometry, Transform
move_7 = Move(Geometry=move_3.Geometry, Motion=Y)  # -> Geometry, Transform
Y_4 = UnitY(Factor=addition_2)
divide_2 = DivideCurve(Curve=ln_3, Count=int_2, Kinks=False)  # -> Points, Tangents, Parameters
move_8 = Move(Geometry=divide_2.Points, Motion=Y_4)  # -> Geometry, Transform
X_2 = UnitX(Factor=addition)
X_3 = UnitX(Factor=addition)
ln_6 = Line(StartPoint=divide_2.Points, EndPoint=move_8.Geometry)
subtraction = Subtraction(A=int, B=Slider(1, range=0..1))
lng = ListLength(List=ln_6)
multiplication = Multiplication(A=subtraction, B=division_3)
X_4 = UnitX(Factor=addition)
subtraction_2 = Subtraction(A=lng, B=Slider(2, range=0..10))
series_3 = Series(Start=Slider(1, range=0..1), Step=1, Count=subtraction_2)
Y_5 = UnitY(Factor=multiplication)
ln_7 = Line(StartPoint=pt_13, EndPoint=pt_10)
move_9 = Move(Geometry=ln_7, Motion=X_2)  # -> Geometry, Transform
ln_8 = Line(StartPoint=pt_11, EndPoint=pt_12)
move_10 = Move(Geometry=ln_8, Motion=X_3)  # -> Geometry, Transform
move_11 = Move(Geometry=ln_4, Motion=Y)  # -> Geometry, Transform
move_12 = Move(Geometry=move_9.Geometry, Motion=Y_5)  # -> Geometry, Transform
item_2 = ListItem(List=ln_6, Index=series_3, Wrap=True)
move_13 = Move(Geometry=ln_2, Motion=Y)  # -> Geometry, Transform
ln_9 = Line(StartPoint=pt_2, EndPoint=move_4.Geometry)
move_14 = Move(Geometry=ln_9, Motion=X)  # -> Geometry, Transform
number_slider_5 = Slider(0.25, range=0.25..1)
move_15 = Move(Geometry=move_10.Geometry, Motion=Y_5)  # -> Geometry, Transform
move_16 = Move(Geometry=ln_7, Motion=Y_5)  # -> Geometry, Transform
move_17 = Move(Geometry=ln_8, Motion=Y_5)  # -> Geometry, Transform
item_3 = ListItem(List=ln_6, Index=Slider(-1, range=-1..0), Wrap=True)
Z_4 = UnitZ(Factor=number_slider_5)
move_18 = Move(Geometry=item_2, Motion=Z_4)  # -> Geometry, Transform
number_slider_6 = Slider(7, range=0..100)
ln_10 = Line(StartPoint=item, EndPoint=move_5.Geometry)
move_19 = Move(Geometry=ln_10, Motion=X_4)  # -> Geometry, Transform
number_slider_7 = Slider(40, range=0..100)
number_slider_8 = Slider(34, range=0..1000)
cross_section = CrossSectionKaramba3D(
    FamilyNameOfCrossSection="DefaultCroSec",
    Height_cm=number_slider_7,
    UpperFlangeWidth_cm=number_slider_8,
    LowerFlangeWidth_cm=number_slider_8,
    UpperFlangeThickness_cm=number_slider_6,
    LowerFlangeThickness_cm=number_slider_6,
    WebThickness_cm=number_slider_6,
    FilletRadius_cm=0,
    mode="I")
linetobeam = LineToBeamKaramba3D(
    Line=item_3,
    CrossSection=cross_section,
    New=True,
    Remove=True,
    LimitDistance_m=0.005,
    Bending=True,
    SetBucklingLength=True,
    ToPolylineMaxAngle=0.03,
    ToPolylineTolerance=0.01,
    ToPolylineMaxEdgeLength=0.25)  # -> Element, Points, Info
neg_4 = Negative(Value=number_slider_5)
cross_section_2 = CrossSectionKaramba3D(
    FamilyNameOfCrossSection="DefaultCroSec",
    Height_cm=number_slider_7,
    UpperFlangeWidth_cm=number_slider_8,
    LowerFlangeWidth_cm=number_slider_8,
    UpperFlangeThickness_cm=number_slider_6,
    LowerFlangeThickness_cm=number_slider_6,
    WebThickness_cm=number_slider_6,
    FilletRadius_cm=0,
    mode="I")
X_5 = UnitX(Factor=neg_4)
move_20 = Move(Geometry=ln_10, Motion=X_5)  # -> Geometry, Transform
cross_section_3 = CrossSectionKaramba3D(
    FamilyNameOfCrossSection="DefaultCroSec",
    Height_cm=number_slider_7,
    UpperFlangeWidth_cm=number_slider_8,
    LowerFlangeWidth_cm=number_slider_8,
    UpperFlangeThickness_cm=number_slider_6,
    LowerFlangeThickness_cm=number_slider_6,
    WebThickness_cm=number_slider_6,
    FilletRadius_cm=0,
    mode="I")
assemble = AssembleModelKaramba3D(Elem=linetobeam.Element, LimitDistance_m=0.005)  # -> Model, Info, Mass_kg, CenterOfGravity, LoadCaseNames
dupln = RemoveDuplicateLines(Lines=move_20.Geometry, Tolerance=0.01)
linetobeam_2 = LineToBeamKaramba3D(
    Line=ln_9,
    CrossSection=cross_section_2,
    New=True,
    Remove=True,
    LimitDistance_m=0.005,
    Bending=True,
    SetBucklingLength=True,
    ToPolylineMaxAngle=0.03,
    ToPolylineTolerance=0.01,
    ToPolylineMaxEdgeLength=0.25)  # -> Element, Points, Info
cross_section_4 = CrossSectionKaramba3D(
    FamilyNameOfCrossSection="DefaultCroSec",
    Height_cm=number_slider_7,
    UpperFlangeWidth_cm=number_slider_8,
    LowerFlangeWidth_cm=number_slider_8,
    UpperFlangeThickness_cm=number_slider_6,
    LowerFlangeThickness_cm=number_slider_6,
    WebThickness_cm=number_slider_6,
    FilletRadius_cm=0,
    mode="I")
linetobeam_3 = LineToBeamKaramba3D(
    Line=ln_3,
    CrossSection=cross_section_3,
    New=True,
    Remove=True,
    LimitDistance_m=0.005,
    Bending=True,
    SetBucklingLength=True,
    ToPolylineMaxAngle=0.03,
    ToPolylineTolerance=0.01,
    ToPolylineMaxEdgeLength=0.25)  # -> Element, Points, Info
linetobeam_4 = LineToBeamKaramba3D(
    Line=ln_5,
    CrossSection=cross_section_4,
    New=True,
    Remove=True,
    LimitDistance_m=0.005,
    Bending=True,
    SetBucklingLength=True,
    ToPolylineMaxAngle=0.03,
    ToPolylineTolerance=0.01,
    ToPolylineMaxEdgeLength=0.25)  # -> Element, Points, Info
assemble_2 = AssembleModelKaramba3D(Elem=linetobeam_2.Element, LimitDistance_m=0.005)  # -> Model, Info, Mass_kg, CenterOfGravity, LoadCaseNames
assemble_3 = AssembleModelKaramba3D(Elem=linetobeam_3.Element, LimitDistance_m=0.005)  # -> Model, Info, Mass_kg, CenterOfGravity, LoadCaseNames
beamview = BeamViewKaramba3D(Model=assemble.Model)  # -> Model, MeshesOfRenderedBeams, DeformedBeamAxes, LegendColors, LegendTags
assemble_4 = AssembleModelKaramba3D(Elem=linetobeam_4.Element, LimitDistance_m=0.005)  # -> Model, Info, Mass_kg, CenterOfGravity, LoadCaseNames
beamview_2 = BeamViewKaramba3D(Model=assemble_2.Model)  # -> Model, MeshesOfRenderedBeams, DeformedBeamAxes, LegendColors, LegendTags
beamview_3 = BeamViewKaramba3D(Model=assemble_3.Model)  # -> Model, MeshesOfRenderedBeams, DeformedBeamAxes, LegendColors, LegendTags
beamview_4 = BeamViewKaramba3D(Model=assemble_4.Model)  # -> Model, MeshesOfRenderedBeams, DeformedBeamAxes, LegendColors, LegendTags
move_21 = Move(Geometry=beamview_4.MeshesOfRenderedBeams, Motion=Y)  # -> Geometry, Transform
mesh = Mesh(beamview_3.MeshesOfRenderedBeams)
division_6 = Division(A=addition, B=Slider(2, range=0..10))
pt_14 = ConstructPoint(XCoordinate=division_6, YCoordinate=0, ZCoordinate=0)
yz = YZPlane(Origin=pt_14)
mesh_2 = Mesh(beamview_2.MeshesOfRenderedBeams)
move_22 = Move(Geometry=mesh, Motion=Y)  # -> Geometry, Transform
mirror = Mirror(Geometry=move_22.Geometry, Plane=yz)  # -> Geometry, Transform
pipe = Pipe(Curve=move_18.Geometry, Radius=Slider(0.07, range=0..0.1), Caps=Slider(1, range=0..1))  # -> flatten(Pipe)
mirror_2 = Mirror(Geometry=pipe, Plane=yz)  # -> flatten(Geometry), Transform
pipe_2 = Pipe(Curve=dupln, Radius=Slider(0.07, range=0..0.1), Caps=Slider(1, range=0..1))  # -> flatten(Pipe)
mirror_3 = Mirror(Geometry=mesh_2, Plane=yz)  # -> Geometry, Transform
number_slider_9 = Slider(1, range=0..1)
mirror_4 = Mirror(Geometry=pipe_2, Plane=yz)  # -> Geometry, Transform
geo = Geometry([mirror.Geometry, move_22.Geometry])
number_slider_10 = Slider(0.1, range=0..1)
geo_2 = Geometry([mirror_2.Geometry, pipe])
pipe_3 = Pipe(Curve=move_15.Geometry, Radius=number_slider_10, Caps=number_slider_9)
geo_3 = Geometry([move_6.Geometry, move_7.Geometry])
pipe_4 = Pipe(Curve=move_16.Geometry, Radius=number_slider_10, Caps=number_slider_9)
pipe_5 = Pipe(Curve=move_9.Geometry, Radius=number_slider_10, Caps=number_slider_9)
pipe_6 = Pipe(Curve=move_17.Geometry, Radius=number_slider_10, Caps=number_slider_9)
pipe_7 = Pipe(Curve=move_10.Geometry, Radius=number_slider_10, Caps=number_slider_9)
pipe_8 = Pipe(Curve=ln_7, Radius=number_slider_10, Caps=number_slider_9)
pipe_9 = Pipe(Curve=move_12.Geometry, Radius=number_slider_10, Caps=number_slider_9)
geo_4 = Geometry([mirror_3.Geometry, mesh_2])
pipe_10 = Pipe(Curve=ln_8, Radius=number_slider_10, Caps=number_slider_9)
mesh_3 = Mesh(move_21.Geometry)
panel_3 = Panel(mesh_3)
mirror_5 = Mirror(Geometry=mesh_3, Plane=yz)  # -> Geometry, Transform
geo_5 = Geometry([mirror_4.Geometry, pipe_2])
geo_6 = Geometry(geo_4)
geo_7 = Geometry([mirror_5.Geometry, mesh_3])
item_4 = ListItem(List=geo_2, Index=0, Wrap=True)
item_5 = ListItem(List=geo_5, Index=0, Wrap=True)
area = Area(Geometry=item_4)  # -> Area, Centroid
geo_8 = Geometry(geo)
item_6 = ListItem(List=geo_6, Index=0, Wrap=True)
area_2 = Area(Geometry=item_5)  # -> Area, Centroid
area_3 = Area(Geometry=item_6)  # -> Area, Centroid
geo_9 = Geometry(geo_7)
geo_10 = Geometry(geo_3)
area_4 = Area(Geometry=geo_2)  # -> Area, Centroid
item_7 = ListItem(List=geo_8, Index=0, Wrap=True)
number_slider_11 = Slider(25, range=25..100)
area_5 = Area(Geometry=geo_5)  # -> Area, Centroid
geo_11 = Geometry(geo_10)
area_6 = Area(Geometry=item_7)  # -> Area, Centroid
area_7 = Area(Geometry=geo_6)  # -> Area, Centroid
item_8 = ListItem(List=geo_9, Index=0, Wrap=True)
area_8 = Area(Geometry=item_8)  # -> Area, Centroid
pt_15 = ConstructPoint(XCoordinate=number_slider_11, YCoordinate=number_slider_11, ZCoordinate=number_slider_11)
vec2pt = Vector2Pt(PointA=area.Centroid, PointB=pt_15, Unitize=False)  # -> Vector, Length
item_9 = ListItem(List=geo_11, Index=0, Wrap=True)
vec2pt_2 = Vector2Pt(PointA=area_2.Centroid, PointB=pt_15, Unitize=False)  # -> Vector, Length
area_9 = Area(Geometry=geo_8)  # -> Area, Centroid
vec2pt_3 = Vector2Pt(PointA=area_3.Centroid, PointB=pt_15, Unitize=False)  # -> Vector, Length
area_10 = Area(Geometry=item_9)  # -> Area, Centroid
geo_12 = Geometry([pipe_10, pipe_7, pipe_3, pipe_6])
area_11 = Area(Geometry=geo_9)  # -> Area, Centroid
geo_13 = Geometry(geo_12)
vec2pt_4 = Vector2Pt(PointA=area_6.Centroid, PointB=pt_15, Unitize=False)  # -> Vector, Length
area_12 = Area(Geometry=geo_11)  # -> Area, Centroid
vec2pt_5 = Vector2Pt(PointA=area_8.Centroid, PointB=pt_15, Unitize=False)  # -> Vector, Length

concat = Concatenate(FragmentA=addition, FragmentB="_")
concat_2 = Concatenate(FragmentA=concat, FragmentB=addition_2)

item_10 = ListItem(List=geo_13, Index=0, Wrap=True)
area_13 = Area(Geometry=item_10)  # -> Area, Centroid
vec2pt_6 = Vector2Pt(PointA=area_10.Centroid, PointB=pt_15, Unitize=False)  # -> Vector, Length
area_14 = Area(Geometry=geo_13)  # -> Area, Centroid
vec2pt_7 = Vector2Pt(PointA=area_13.Centroid, PointB=pt_15, Unitize=False)  # -> Vector, Length
panel_4 = Panel("Purlins")
move_23 = Move(Geometry=item_4, Motion=vec2pt.Vector)  # -> Geometry, Transform
panel_5 = Panel("Crane beam")
move_24 = Move(Geometry=item_5, Motion=vec2pt_2.Vector)  # -> Geometry, Transform
panel_6 = Panel("Steel Column")
move_25 = Move(Geometry=item_8, Motion=vec2pt_5.Vector)  # -> Geometry, Transform
panel_7 = Panel("Roof Side Beam")
panel_8 = Panel("X bracing")
move_26 = Move(Geometry=item_9, Motion=vec2pt_6.Vector)  # -> Geometry, Transform
move_27 = Move(Geometry=item_6, Motion=vec2pt_3.Vector)  # -> Geometry, Transform
move_28 = Move(Geometry=item_10, Motion=vec2pt_7.Vector)  # -> Geometry, Transform

panel_9 = Panel("Roof Beam")
move_29 = Move(Geometry=item_7, Motion=vec2pt_4.Vector)  # -> Geometry, Transform
concat_3 = Concatenate(FragmentA="Roofbeam_", FragmentB=concat_2)
concat_4 = Concatenate(FragmentA="your path here\Meshes\", FragmentB=concat_3)
concat_5 = Concatenate(FragmentA=concat_4, FragmentB=".stl")
panel_10 = Panel(concat_5)
pcexportstl = ExportSTL(
    Mesh=move_29.Geometry,
    Relocate=Toggle(False),
    SavePath=concat_5,
    SaveAsBinaryFile=True,
    SaveNow=Toggle(False),
    LastSaveLocalization="neutral,N")

concat_6 = Concatenate(FragmentA="Purlins_", FragmentB=concat_2)
concat_7 = Concatenate(FragmentA="your path here\Meshes\", FragmentB=concat_6)
concat_8 = Concatenate(FragmentA=concat_7, FragmentB=".stl")
panel_11 = Panel(concat_8)
pcexportstl_2 = ExportSTL(
    Mesh=move_23.Geometry,
    Relocate=Toggle(False),
    SavePath=concat_8,
    SaveAsBinaryFile=True,
    SaveNow=Toggle(False),
    LastSaveLocalization="neutral,N")

concat_9 = Concatenate(FragmentA="Cranebeam_", FragmentB=concat_2)
concat_10 = Concatenate(FragmentA="your path here\Meshes\", FragmentB=concat_9)
concat_11 = Concatenate(FragmentA=concat_10, FragmentB=".stl")
panel_12 = Panel(concat_11)
pcexportstl_3 = ExportSTL(
    Mesh=move_24.Geometry,
    Relocate=Toggle(False),
    SavePath=concat_11,
    SaveAsBinaryFile=True,
    SaveNow=Toggle(False),
    LastSaveLocalization="neutral,N")

vec2pt_8 = Vector2Pt(PointA=pt_15, PointB=area_4.Centroid, Unitize=False)  # -> Vector, Length
vec2pt_9 = Vector2Pt(PointA=pt_15, PointB=area_5.Centroid, Unitize=False)  # -> Vector, Length

concat_12 = Concatenate(FragmentA="Steelcolumn_", FragmentB=concat_2)
concat_13 = Concatenate(FragmentA="your path here\Meshes\", FragmentB=concat_12)
concat_14 = Concatenate(FragmentA=concat_13, FragmentB=".stl")
panel_13 = Panel(concat_14)
pcexportstl_4 = ExportSTL(
    Mesh=move_25.Geometry,
    Relocate=Toggle(False),
    SavePath=concat_14,
    SaveAsBinaryFile=True,
    SaveNow=Toggle(False),
    LastSaveLocalization="neutral,N")

panel_14 = Panel("Foundation")
concat_15 = Concatenate(FragmentA="Foundation_", FragmentB=concat_2)
concat_16 = Concatenate(FragmentA="Enter path here\Meshes\", FragmentB=concat_15)
concat_17 = Concatenate(FragmentA=concat_16, FragmentB=".stl")
panel_15 = Panel(concat_17)
pcexportstl_5 = ExportSTL(
    Mesh=move_26.Geometry,
    Relocate=Toggle(False),
    SavePath=concat_17,
    SaveAsBinaryFile=True,
    SaveNow=Toggle(False),
    LastSaveLocalization="neutral,N")

concat_18 = Concatenate(FragmentA="X_", FragmentB=concat_2)
concat_19 = Concatenate(FragmentA="you path here\Meshes\", FragmentB=concat_18)
concat_20 = Concatenate(FragmentA=concat_19, FragmentB=".stl")
panel_16 = Panel(concat_20)
pcexportstl_6 = ExportSTL(
    Mesh=move_28.Geometry,
    Relocate=Toggle(False),
    SavePath=concat_20,
    SaveAsBinaryFile=True,
    SaveNow=Toggle(False),
    LastSaveLocalization="neutral,N")

concat_21 = Concatenate(FragmentA="Roofsidebeam_", FragmentB=concat_2)
concat_22 = Concatenate(FragmentA="your path here\Meshes\", FragmentB=concat_21)
concat_23 = Concatenate(FragmentA=concat_22, FragmentB=".stl")
panel_17 = Panel(concat_23)
pcexportstl_7 = ExportSTL(
    Mesh=move_27.Geometry,
    Relocate=Toggle(False),
    SavePath=concat_23,
    SaveAsBinaryFile=True,
    SaveNow=Toggle(False),
    LastSaveLocalization="neutral,N")

vec2pt_10 = Vector2Pt(PointA=pt_15, PointB=area_11.Centroid, Unitize=False)  # -> Vector, Length
vec2pt_11 = Vector2Pt(PointA=pt_15, PointB=area_7.Centroid, Unitize=False)  # -> Vector, Length
vec2pt_12 = Vector2Pt(PointA=pt_15, PointB=area_9.Centroid, Unitize=False)  # -> Vector, Length
vec2pt_13 = Vector2Pt(PointA=pt_15, PointB=area_14.Centroid, Unitize=False)  # -> Vector, Length
vec2pt_14 = Vector2Pt(PointA=pt_15, PointB=area_12.Centroid, Unitize=False)  # -> Vector, Length
